vi "Get Earthquake Location.gviweb"   [LabVIEW NXG 5.0.0]
inputs:
  "JSON": string
  "Earthquake index": i32 = 1
  "error in": error
outputs:
  "latitude": f64
  "longitude": f64
  "depth": f64
  "error out": error
diagram:
  Format Into String(formatString="%d", errIn=$"error in", $"Earthquake index") -> (outString=w1, errOut=w2)
  Build Array("features", w1, "geometry") -> w3
  w4 = cluster{"type": string, "coordinates": f64[]} {all zero or empty}
  Unflatten From Json(JSON string=$JSON, default null elements=TRUE, error in (no error)=w2, path=w3, type and defaults=w4) -> (error out=w5, value=w6)
  Property Node(instance in=w6) -> ("coordinates"=w7)
  Array Index(array=w7) -> (out0[_]=w8, out1[1]=w9, out2[2]=w10)
  $latitude <- w8
  $longitude <- w9
  $depth <- w10
  $"error out" <- w5
